# Requirement set HLR_ModeLogic_EARS (R2025b)

## 1 [16] Establish Communications (Container)

### 1.1 [17] Enter Establish Communications at Power Up
When the flight control system powers up, the system shall enter the Establish Communications mode.

### 1.2 [18] Enter Establish Communications from Crash
When the system is in crash mode, the system shall enter the Establish Communications mode.

### 1.3 [19] Enter Establish Communications from Land
When the system is in Land mode and the quadcopter's roll angle is less than 5 degrees, pitch angle is less than 5 degrees, and vertical velocity is less than 0.1 m/s, the system shall enter the Establish Communications mode.

## 2 [25] Calibrate the Sensors (Container)

### 2.1 [26] Enter Calibrate Sensors from Initialization
When the system is in Initialization mode and the ground station issues a calibration command, the system shall enter the Calibrate Sensors mode.

### 2.2 [27] Enter Calibrate Sensors from Ready for Flight
When the system is in Ready for Flight mode and the ground station issues a calibration command, the system shall enter the Calibrate Sensors mode.