% Simulink data dictionary bus_types.sldd

GCSCommands = Simulink.Bus()
  EMERGENCY_OFF: boolean
  WIFIconnected: boolean
  BTconnected: boolean
  CalibrateCmd: boolean
  GCS_MissionMode: uint8
  GCS_HeadingCmd: single

Logic = Simulink.Bus()
  CalibrateSensors: boolean
  Mode: uint8

State = Simulink.Bus()
  CalibrationDone: boolean
  Pos_BODY: single[3 1]
  Pos_FSD: single[3 1]
  V_BODY: single[3]
  V_FSD: single[3 1]
  Acc_BODY: single[3 1]
  Acc_FSD: single[3 1]
  AngRate: single[3 1]
  Angles: single[3]
  Heading: single
  Altitude: single
  BatteryVolts: single